# Grasshopper definition gh2vvvv [Sep-29 '12, 1709(2)].gh (Grasshopper 0.9.14)

path = FilePath("E:\Dropbox\Mathrioshka Project\UNKproject\Model\feed-vvvv2gh.txt")
expression = Expression(x="1920", Expression="x*3")
file = ReadFile(Path=path, Lines=Toggle(False))
rectangle = Rectangle(Plane=PlaneXY(0, 0, 0), XSize=expression, YSize="1080", Radius=0)  # -> Rectangle, Length
pop2d = Populate2D(Region=rectangle.Rectangle, Count="100", Seed=1)
pt = Point(flatten(pop2d))
expression_2 = Expression(x=expression, y="150", Expression="(x+y)/2")
expression_3 = Expression(x="1080", y="150", Expression="(x+y)/2")
split = StringSplit(String=file, Separators=" ")
dispatch = Dispatch(List=split, DispatchPattern=[True, False])  # -> ListA, ListB
bbox = BoundingBox(Content=pt, Plane=PlaneXY(0, 0, 0), UnionBox=True)  # -> Box, Box_2
dom = Domain(DomainStart=0, DomainEnd=expression)
dom_2 = Domain(DomainStart=0, DomainEnd="1080")
area = Area(Geometry=bbox.Box)  # -> Area, Centroid
remap = RemapNumbers(Value=dispatch.ListA, Source=Domain(-1, 1), Target=dom)
remap_2 = RemapNumbers(Value=dispatch.ListB, Source=Domain(-1, 1), Target=dom_2)
box = CenterBox(Base=area.Centroid, X=expression_2, Y=expression_3, Z=1)
pt_2 = PointXYZ(XComponent=remap, YComponent=remap_2, ZComponent=0, System=PlaneXY(0, 0, 0))
multiplication = Multiplication(
    A=[Slider(100, range=-100..100), Slider(-100, range=-100..100), Slider(100, range=-100..100)],
    B=Slider(74, range=-1..100))
pcharge = PointCharge(Point=pt_2, Charge=multiplication, Decay=Slider(0.67, range=0..3))
mergef = MergeFields(Fields=pcharge)
fscalar = ScalarDisplay(Field=mergef, Section=rectangle.Rectangle, Samples=2000)  # disabled
evf = EvaluateField(Field=mergef, Point=pt)  # -> Tensor, Strength
vdisex = VectorDisplayEx(Point=pt, Vector=evf.Tensor, Colour=RGB(0, 0, 0), Width=1)  # disabled
move = Move(Geometry=pt, Motion=evf.Tensor)  # -> Geometry, Transform
pt_3 = Point(flatten(move.Geometry))
pt_4 = Point(flatten(pt_3))
box_2 = Box(box)
voronoi = Voronoi(Points=pt_4, Radius=3000, Box=box_2, Plane=PlaneXY(0, 0, 0), BruteForceOverride=False)
pcen = PolygonCenter(Polyline=voronoi)  # -> graft(CenterV), graft(CenterE)
cp = ControlPoints(Curve=voronoi)  # -> Points, Weights, Knots
ln = Line(StartPoint=cp.Points, EndPoint=pcen.CenterE)
eval = EvaluateCurve(Curve=ln, Parameter=Slider(0.77, range=0..1))  # -> Point, Tangent, Angle
shift = ShiftList(List=cp.Points, Shift=1, Wrap=False)  # -> graft(List)
shift_2 = ShiftList(List=cp.Points, Shift=-1, Wrap=False)  # -> graft(List)
shift_3 = ShiftList(List=eval.Point, Shift=1, Wrap=False)  # -> graft(List)
shift_4 = ShiftList(List=eval.Point, Shift=-1, Wrap=False)  # -> graft(List)
merge = Merge(Data1=shift, Data2=shift_2, Data3=shift_4, Data4=shift_3)
pt_5 = Point(flatten(merge))
pline = PolyLine(Closed=True)
cset = CreateSet(List=pt_5)  # -> Set, Map
planar = PlanarSrf(Edges=pline)
pcomp = Decompose(Point=cset.Set, System=PlaneXY(0, 0, 0))  # -> XComponent, YComponent, ZComponent
int = Integer(pcomp.XComponent)
int_2 = Integer(pcomp.YComponent)
merge_2 = Merge(Data1=graft(int), Data2=graft(int_2))  # -> flatten(Result)
join = StringJoin(Strings=merge_2, Join=",")
panel = Panel(cset.Map)
panel_2 = Panel(join)
