# Grasshopper definition gh2vvvv.gh (Grasshopper 0.9.14)
# plug-ins: HoopSnake, gHowl

# ----
# from MAX Attractors
panel = Panel("4445")
udp = UDPReceiver(Port=panel, Pattern=999)  # -> Info, Data
shift = ShiftList(List=udp.Data, Shift=1, Wrap=False)

expression = Expression(x="1920", Expression="x*3")

rectangle = Rectangle(Plane=PlaneXY(0, 0, 0), XSize=expression, YSize="1080", Radius=0)  # -> Rectangle, Length
panel_2 = Panel("""0.1
0.5
0.4
0.6
0.8
0.1""")
pop2d = Populate2D(Region=rectangle.Rectangle, Count="100", Seed=1)
sort_pt = SortPoints(Points=pop2d)  # -> Points, Indices
expression_2 = Expression(x=expression, y="3000", Expression="(x+y)/2")
expression_3 = Expression(x="1080", y="3000", Expression="(x+y)/2")
filter = StreamFilter(Gate=Toggle(False), Stream0=shift, Stream1=panel_2)
pt = Point(flatten(sort_pt.Points))
bbox = BoundingBox(Content=pt, Plane=PlaneXY(0, 0, 0), UnionBox=True)  # -> Box, Box_2
dispatch = Dispatch(List=filter, DispatchPattern=[True, False])  # -> ListA, ListB
dom = Domain(DomainStart=0, DomainEnd=expression)
dom_2 = Domain(DomainStart=0, DomainEnd="1080")
area = Area(Geometry=bbox.Box)  # -> Area, Centroid
box = CenterBox(Base=area.Centroid, X=expression_2, Y=expression_3, Z=1)
remap = RemapNumbers(Value=dispatch.ListB, Source="0.0 To 1.0", Target=dom_2)
remap_2 = RemapNumbers(Value=dispatch.ListA, Source="0.0 To 1.0", Target=dom)
valuemultiplicator = Slider(20, range=-1..200)
decay = Slider(0.44, range=0..3)
pt_2 = PointXYZ(XComponent=remap_2, YComponent=remap, ZComponent=0, System=PlaneXY(0, 0, 0))
multiplication = Multiplication(A=[Slider(100, range=-100..100), Slider(-56, range=-100..100), Slider(100, range=-100..100)], B=valuemultiplicator)
pcharge = PointCharge(Point=pt_2, Charge=multiplication, Decay=decay)
mergef = MergeFields(Fields=pcharge)
fscalar = ScalarDisplay(Field=mergef, Section=rectangle.Rectangle, Samples=2000)  # disabled
evf = EvaluateField(Field=mergef, Point=pt)  # -> Tensor, Strength
move = Move(Geometry=pt, Motion=evf.Tensor)  # -> Geometry, Transform
vdisex = VectorDisplayEx(Point=pt, Vector=evf.Tensor, Colour=RGB(0, 0, 0), Width=3)  # disabled
pt_3 = Point(flatten(move.Geometry))
box_2 = Box(box)

# ----
# Center Points
pcomp = Decompose(Point=pt_3, System=PlaneXY(0, 0, 0))  # -> XComponent, YComponent, ZComponent
dirección_osc = Panel("/GH/CenterPointsXY")
int = Integer(pcomp.XComponent)
int_2 = Integer(pcomp.YComponent)
merge = Merge(Data1=graft(int), Data2=graft(int_2))
join = StringJoin(Strings=merge, Join=" ")
merge_2 = Merge(Data1=dirección_osc, Data2=join)  # -> flatten(Result)
patrón_osc = Panel("999")
panel_3 = Panel(merge_2)
udp_2 = UDPSender(Port="6666", Pattern=patrón_osc, Data=merge_2)
panel_4 = Panel(udp_2)

voronoi = Voronoi(Points=pt_3, Radius=3000, Box=box_2, Plane=PlaneXY(0, 0, 0), BruteForceOverride=False)

# ----
# Center Points / 64p
reduce = RandomReduce(List=flatten(join), Reduction=36, Seed=1)
patrón_osc_2 = Panel("999")
merge_3 = Merge(Data1=dirección_osc, Data2=reduce)  # -> flatten(Result)
udp_3 = UDPSender(Port="6667", Pattern=patrón_osc_2, Data=merge_3)
panel_5 = Panel(udp_3)

# ----
# Отсюда можно отключить
# для скорости
cp = ControlPoints(Curve=voronoi)  # -> Points, Weights, Knots
shift_2 = ShiftList(List=cp.Points, Shift=-1, Wrap=False)
pt_4 = Point(graft(pt_3))

toggle = BooleanToggle(False)

panel_6 = Panel("999")
udp_4 = UDPReceiver(Port="6669", Pattern=0)  # -> Info, Data
panel_7 = Panel(udp_4.Data)

dist = Distance(PointA=shift_2, PointB=pt_4)
avr = Average(Input=dist)
range = Range(Domain=Domain(0, 1), Steps=99)
lng = ListLength()  # -> flatten(Length); disabled
graph = GraphMapper(
    range,
    x0=0,
    x1=1,
    y0=0,
    y1=1,
    container_name="Parabola",
    Ox=0.5014507174,
    Oy=0.06376758218,
    Px=0.7797108293,
    Py=0.3420286179)
bnd = Bounds(Numbers=lng)  # disabled
multiplication_2 = Multiplication(A=udp_4.Data, B="100")
series = Series(Start=0, Step=1, Count="9")
panel_8 = Panel(bnd)  # disabled
number_slider = Slider(1, range=0..1)
shift_3 = ShiftList(List=graph, Shift=multiplication_2, Wrap=True)
num = Number(graft(shift_3))
slider = Slider(17, range=0..100)  # disabled
dirección_osc_2 = Panel("/GH/VoronoiPointsXY")
patrón_osc_3 = Panel("999")

Z = UnitZ(Factor=1)
X = UnitX(Factor=1)

# ----
# Count Edge
dirección_osc_3 = Panel("/GH/CountEdge")  # disabled
patrón_osc_4 = Panel("999")  # disabled
panel_9 = Panel("6669")  # disabled

range_2 = Range(Domain=Domain(0.3, 0.6), Steps=8)  # disabled

slider_2 = Slider(603, range=600..620)  # disabled

item = ListItem(List=hs.FeedbackHistory, Index=0, Wrap=False)
pt_5 = Point(item)  # disabled
rec = DataRecorder(pt_5, RecordData=True, DataLimit=1)  # disabled
dam = DataDam(DataA=rec, BufferDelay=2500000, BufferMode=1)  # disabled
vec2pt = Vector2Pt(PointA=pt_4, PointB=item, Unitize=False)  # -> Vector, Length
vrot = Rotate(Vector=vec2pt.Vector, Axis=Z, Angle=Slider(0.37, range=0..1))
angle = Angle(VectorA=X, VectorB=vrot)  # -> Angle, Reflex
prot = RotatePlane(Plane=pt_4, Angle=angle.Angle)
vdisex_2 = VectorDisplayEx(Point=prot, Vector=vrot, Colour=RGB(0, 0, 0), Width=1)  # disabled

cir = Circle(Plane=prot, Radius=avr)
crv_cp = CurveCP(Point=shift_2, Curve=cir)  # -> Point, Parameter, Distance
sort = SortList(Keys=crv_cp.Parameter, ValuesA=shift_2)  # -> Keys, ValuesA
hs = HoopSnake(
    StartingData=shift_2,
    Data=sort.ValuesA,
    TerminationCondition=toggle,
    Trigger=toggle,
    Hoopsnake_Data_dataLimit=2147483647,
    Hoopsnake_Data_resetCounter=True,
    Hoopsnake_Data_updateView=True,
    Hoopsnake_Data_autoUpdate=False)  # -> Feedback, FeedbackHistory, LoopsCounter, IterationsCounter
shift_4 = ShiftList(List=sort.ValuesA, Shift=0, Wrap=True)
lng_2 = ListLength(List=shift_4)  # disabled
str = String(flatten(lng_2))  # disabled
join_2 = StringJoin(Strings=str, Join=" ")  # disabled
split = SplitList(List=shift_4, Index="9")  # -> ListA, ListB
long = LongList(ListA=split.ListA, ListB=series, PaddingMode=2)  # -> ListA, ListB
pt_6 = Point(long.ListA)
ln = Line(StartPoint=pt_6, EndPoint=pt_4)
eval = EvaluateCurve(Curve=ln, Parameter=num)  # -> Point, Tangent, Angle
points = PointList(Points=flatten(eval.Point), Tags=True, Lines=False, Size=slider)  # disabled
shift_5 = ShiftList(List=pt_6, Shift=0, Wrap=True)  # -> graft(List)
shift_6 = ShiftList(List=pt_6, Shift=-1, Wrap=True)  # -> graft(List)
shift_7 = ShiftList(List=eval.Point, Shift=0, Wrap=True)  # -> graft(List)
shift_8 = ShiftList(List=eval.Point, Shift=-1, Wrap=True)  # -> graft(List)
merge_4 = Merge(Data1=shift_5, Data2=shift_6, Data3=shift_7, Data4=shift_8)
viewer = ParamViewer(merge_4)  # disabled
item_2 = ListItem(List=viewer, Index=0, Wrap=False)  # disabled
pt_7 = Point(flatten(merge_4))
lng_3 = ListLength(List=pt_7)  # -> flatten(Length); disabled
panel_10 = Panel(lng_3)  # disabled
branch = TreeBranch(Tree=merge_4, Path=item_2, MaintainPaths=True)  # disabled
pcomp_2 = Decompose(Point=pt_7, System=PlaneXY(0, 0, 0))  # -> XComponent, YComponent, ZComponent

merge_5 = Merge(Data1=shift_5, Data2=shift_6, Data3=shift_8, Data4=shift_7)  # disabled
pline = PolyLine(Vertices=merge_5, Closed=True)  # disabled
planar = PlanarSrf(Edges=flatten(pline))  # disabled

eval_2 = EvaluateCurve(Curve=ln, Parameter=range_2)  # -> Point, Tangent, Angle; disabled
path_mapper = PathMapper(pline, source="{A;B;C;D;E;F;G;H}", target="{C}")  # disabled
pcen = PolygonCenter(Polyline=path_mapper)  # -> CenterV, CenterE; disabled
points_2 = PointList(Points=pcen.CenterE, Tags=True, Lines=True, Size=10)  # disabled

item_3 = ListItem(List=flatten(pline), Index=slider_2, Wrap=False)  # disabled
planar_2 = PlanarSrf(Edges=flatten(item_3))  # disabled

int_3 = Integer(pcomp_2.XComponent)
int_4 = Integer(pcomp_2.YComponent)
points_3 = PointList(Points=branch, Tags=True, Lines=False, Size=slider)  # disabled
merge_6 = Merge(Data1=graft(int_3), Data2=graft(int_4))  # -> flatten(Result); disabled
path_mapper_2 = PathMapper(merge_6, source="{A}(i)", target="{i\400}")  # disabled
join_3 = StringJoin(Strings=path_mapper_2, Join=" ")  # -> flatten(Result); disabled
join_4 = StringJoin(Strings=merge_6, Join=" ")  # disabled
lng_4 = ListLength(List=join_3)  # disabled
rec_2 = DataRecorder(join_4, RecordData=True, DataLimit=2)  # disabled
series_2 = Series(Start=0, Step=1, Count=lng_4)  # disabled
clean = CleanTree(Data=rec_2, CleanInvalid=True, CleanEmpty=False)  # disabled
int_5 = Integer(series_2)  # disabled
merge_7 = Merge(Data1=graft(int_3), Data2=graft(int_4))
concat = Concatenate(A=dirección_osc_2, B=int_5)  # disabled
item_4 = ListItem(List=clean, Index=0, Wrap=False)  # disabled
join_5 = StringJoin(Strings=merge_7, Join=" ")  # -> flatten(Result)
panel_11 = Panel(item_4)  # disabled
item_5 = ListItem(List=join_3, Index=0, Wrap=False)  # disabled
concat_2 = Concatenate(A=concat, B=join_3)  # disabled
item_6 = ListItem(List=concat, Index=0, Wrap=False)  # disabled
merge_8 = Merge(Data1=flatten(item_6), Data2=flatten(item_5))  # disabled
join_6 = StringJoin(Strings=merge_8, Join=" ")  # -> flatten(Result); disabled
merge_9 = Merge(Data1=dirección_osc_2, Data2=join_5)  # -> flatten(Result)
udp_5 = UDPSender(Port="7777", Pattern=patrón_osc_3, Data=merge_9)
panel_12 = Panel(udp_5)

merge_10 = Merge(Data1=dirección_osc_3, Data2=join_2)  # -> flatten(Result); disabled
panel_13 = Panel(merge_10)  # disabled

udp_6 = UDPSender(Port=panel_9, Pattern=patrón_osc_4, Data=merge_10)  # disabled

panel_14 = Panel(udp_6)  # disabled
